# Grasshopper definition parametric shelf.gh (Grasshopper 1.0.8)

opening_ratio = Slider(26, range=0..90)
box = Box({Plane=PlaneXY(23.5332471, 20.26031295, 0), X=Domain(0, 48.57176487), Y=Domain(0, 55.77442356), Z=Domain(0, 21.37456787)})
opening_ratio_2 = GetInteger(opening_ratio, AtLeast=1, AtMost=1, Maximum=2147483647, Minimum=-2147483648, TreeAccess=False)
deconstruct_brep = DeconstructBrep(Brep=box)  # -> Faces, Edges, Vertices
list_item = ListItem(List=deconstruct_brep.Faces, Index=1, Wrap=True)
divide_domain² = DivideDomain²(Domain=list_item, UCount=Slider(20, range=0..100), VCount=Slider(10, range=0..100))
isotrim = Isotrim(Surface=list_item, Domain=divide_domain²)
area = Area(Geometry=box)  # -> Area, Centroid
area_2 = Area(Geometry=isotrim)  # -> Area, Centroid
deconstruct_brep_2 = DeconstructBrep(Brep=list_item)  # -> Faces, Edges, Vertices
face_normals = FaceNormals(Mesh=list_item)  # -> Centers, Normals
distance = Distance(PointA=area_2.Centroid, PointB=area.Centroid)
cull_index = CullIndex(List=deconstruct_brep.Faces, Indices=1, Wrap=True)
multiplication = Multiplication(B=Slider(2.5, range=0..10))
division = Division(A=[multiplication, opening_ratio_2], B=Slider(2, range=0..10))
larger_than = LargerThan(FirstNumber=distance, SecondNumber=division)  # -> LargerThan, OrEqualTo
unit_vector = UnitVector(Vector=face_normals.Normals)
list_item_2 = ListItem(List=deconstruct_brep_2.Faces, Index=Slider(4, range=0..10), Wrap=True)
negative = Negative(Value=unit_vector)
area_3 = Area(Geometry=list_item_2)  # -> Area, Centroid
dispatch = Dispatch(List=isotrim, DispatchPattern=larger_than.LargerThan)  # -> ListA, ListB
multiplication_2 = Multiplication(A=negative, B=Slider(17, range=0..50))
geometry = Geometry(dispatch.ListA)
geometry_2 = Geometry(dispatch.ListB)
move = Move(Geometry=area_3.Centroid, Motion=multiplication_2)  # -> Geometry, Transform
deconstruct_brep_3 = DeconstructBrep(Brep=geometry)  # -> Faces, Edges, Vertices
division_2 = Division(A=opening_ratio_2, B=Slider(5, range=0..10))
count = Slider(68, range=0..100)
radius = Slider(1.02779, range=0..5)
turns = Slider(25, range=0..25)
line_sdl = LineSDL(Start=move.Geometry, Direction=face_normals.Normals, Length=division_2)
list_item_3 = ListItem(List=deconstruct_brep_3.Edges, Index=0, Wrap=True)  # -> flatten(Item)
end_points = EndPoints(Curve=line_sdl)  # -> Start, End
perp_frames = PerpFrames(Curve=line_sdl, Count=count, Align=True)  # -> Frames, Parameters
division_3 = Division(A=turns, B=count)
multiplication_3 = Multiplication(A=division_3, B=-1)
circle = Circle(Plane=perp_frames.Frames, Radius=radius)
expression = Expression(x=radius, Expression="2*π*x")
stream_filter = StreamFilter(Gate=Toggle(True), Stream0=division_3, Stream1=multiplication_3)
series = Series(Start=0, Step=stream_filter, Count=expr("x+1", count))
multiplication_4 = Multiplication(A=expression, B=series)
evaluate_curve = EvaluateCurve(Curve=circle, Parameter=multiplication_4)  # -> Point, Tangent, Angle
rotate = Rotate(Geometry=geometry, Angle=degrees(opening_ratio_2), Plane=list_item_3)  # -> Geometry, Transform
interpolate = Interpolate(Vertices=evaluate_curve.Point, Degree=3, Periodic=False, KnotStyle=1)  # -> Curve, Length, Domain
sphere = Sphere(Base=end_points.End, Radius=Slider(6, range=0..10))
geometry_3 = Geometry(cull_index)
merge = Merge(Data1=rotate.Geometry, Data2=geometry_3, Data3=sphere, Data4=interpolate.Curve)  # -> flatten(Result)
springbox = ContextBake(Content=merge)
